# Grasshopper definition bridge.gh (Grasshopper 1.0.7)
# plug-ins: Bifocals

heigth = Slider(4, range=0..10)
length = Slider(21, range=0..50)
width = Slider(3, range=0..30)
count = Slider(17, range=2..30)

construct_point = ConstructPoint(XCoordinate=0, YCoordinate=width, ZCoordinate=0)
construct_point_2 = ConstructPoint(XCoordinate=0, YCoordinate=0, ZCoordinate=0)
merge = Merge(Data1=construct_point, Data2=construct_point_2)
unit_x = UnitX(Factor=1)
line_sdl = LineSDL(Start=merge, Direction=unit_x, Length=length)

curve_middle = CurveMiddle(Curve=line_sdl)
unit_z = UnitZ(Factor=heigth)
end_points = EndPoints(Curve=line_sdl)  # -> Start, End
move = Move(Geometry=curve_middle, Motion=unit_z)  # -> Geometry, Transform
arc_3pt = Arc3Pt(PointA=end_points.Start, PointB=move.Geometry, PointC=end_points.End)  # -> Arc, Plane, Radius

divide_curve = DivideCurve(Curve=line_sdl, Count=expr("x-1", count), Kinks=False)  # -> Points, Tangents, Parameters
divide_curve_2 = DivideCurve(Curve=arc_3pt.Arc, Count=count, Kinks=False)  # -> Points, Tangents, Parameters
panel = Panel("""0
-1""")
cull_index = CullIndex(List=divide_curve_2.Points, Indices=panel, Wrap=True)
cull_index_2 = CullIndex(List=divide_curve.Points, Indices=panel, Wrap=True)
weave = Weave(Pattern=[0, 1], Stream0=cull_index, Stream1=cull_index_2, NullGaps=False)
polyline = PolyLine(Vertices=weave, Closed=False)

flip_matrix = FlipMatrix(Data=divide_curve.Points)
list_item = ListItem(List=flip_matrix, Index=0, Wrap=True)  # -> Item, Item1
line = Line(StartPoint=list_item.Item, EndPoint=list_item.Item1)

flip_matrix_2 = FlipMatrix(Data=divide_curve_2.Points)
list_item_2 = ListItem(List=flip_matrix_2, Index=0, Wrap=True)  # -> Item, Item1
line_2 = Line(StartPoint=list_item_2.Item, EndPoint=list_item_2.Item1)

shift_list = ShiftList(List=list_item.Item1, Shift="1", Wrap="false")
shortest_list = ShortestList(ListListA=flatten(list_item.Item), ListListB=shift_list, TrimMode=2)  # -> ListListA, ListListB
line_3 = Line(StartPoint=shortest_list.ListListA, EndPoint=shortest_list.ListListB)

shift_list_2 = ShiftList(List=flatten(line), Shift="1", Wrap="false")
cull_index_3 = CullIndex(List=flatten(line), Indices="-1", Wrap=True)
ruled_surface = RuledSurface(CurveA=cull_index_3, CurveB=shift_list_2)

cluster = Cluster(
    curve_4=line_2,
    curve_2=polyline,
    curve_5=line_sdl,
    curve_3=arc_3pt.Arc,
    curve=line,
    surface=ruled_surface,
    curve_6=line_3)

# ==== cluster Cluster
curve = ClusterInput()
curve_2 = ClusterInput()
curve_3 = ClusterInput()
surface = ClusterInput()
curve_4 = ClusterInput()
curve_5 = ClusterInput()
curve_6 = ClusterInput()

curve_7 = Curve(curve)
curve_8 = Curve(curve_2)
curve_9 = Curve(curve_3)
surface_2 = Surface(surface)
curve_10 = Curve(curve_4)
curve_11 = Curve(curve_5)
curve_12 = Curve(curve_6)
