# Grasshopper definition pot.gh (Grasshopper 1.0.7)

number_slider = Slider(36, range=0..50)
xy_plane = XYPlane(Origin=Point(0, 0, 0))
circle = Circle(Plane=xy_plane, Radius=Slider(14.682, range=0..30))
offset_curve = OffsetCurve(Curve=circle, Distance=Slider(5, range=0..30), Corners=1)
divide_curve = DivideCurve(Curve=offset_curve, Count=number_slider, Kinks=False)  # -> Points, Tangents, Parameters
divide_curve_2 = DivideCurve(Curve=circle, Count=number_slider, Kinks=False)  # -> Points, Tangents, Parameters
dispatch = Dispatch(List=divide_curve.Points, DispatchPattern=[True, False])  # -> ListA, ListB
dispatch_2 = Dispatch(List=divide_curve_2.Points, DispatchPattern=[True, False])  # -> ListA, ListB
number_slider_2 = Slider(54, range=0..100)
point = Point(dispatch.ListA)
point_2 = Point(dispatch_2.ListA)
weave = Weave(Pattern=[0, 1], Stream0=point_2, Stream1=point, NullGaps=False)
series = Series(Start=0, Step=Slider(1, range=0..5), Count=number_slider_2)
nurbs_curve = NurbsCurve(Vertices=weave, Degree=3, Periodic=True)  # -> Curve, Length, Domain
unit_z = UnitZ(Factor=series)
move = Move(Geometry=nurbs_curve.Curve, Motion=unit_z)  # -> Geometry, Transform
construct_domain = ConstructDomain(DomainStart=Slider(3, range=0..360), DomainEnd=Slider(41, range=0..1000))
area = Area(Geometry=move.Geometry)  # -> Area, Centroid
range = Range(Domain=construct_domain, Steps=number_slider_2)
radians = Radians(Degrees=range)
rotate = Rotate(Geometry=move.Geometry, Angle=radians, Plane=area.Centroid)  # -> Geometry, Transform
range_2 = Range(Domain=Domain(0, 1), Steps=number_slider_2)
multiplication = Multiplication(A=range_2, B=Slider(1, range=1..5))
graph_mapper = GraphMapper(
    multiplication,
    x0=0,
    x1=1,
    y0=0,
    y1=1,
    container_name="Sine",
    Equation_px=[0.05899245292, 0.5150822997],
    Equation_py=[0.5110526085, 0.9160549641])
scale = Scale(Geometry=rotate.Geometry, Center=area.Centroid, Factor=graph_mapper)  # -> Geometry, Transform
